# Grasshopper definition DataMgtAssn01.gh (Grasshopper 1.0.7)
# plug-ins: Kangaroo2 Components

arc_radius = Slider(44.14, range=20..100)
number_of_arcs = Slider(5, range=1..5)
arc_radius_2 = GetNumber(arc_radius, AtLeast=1, AtMost=1, Maximum=100, Minimum=20, TreeAccess=False)
number_of_arcs_2 = GetInteger(number_of_arcs, AtLeast=1, AtMost=1, Maximum=5, Minimum=1, TreeAccess=False)
mesh_size = GetNumber(Slider(20, range=20..50), AtLeast=1, AtMost=1, Maximum=50, Minimum=20, TreeAccess=False)

# ---- group: 2 ARCS
xz_plane = XZPlane(Origin=Point(0, 0, 0))
arc = Arc(Plane=xz_plane, Radius=arc_radius_2, Angle=Domain(0, 3.141592654))  # -> Arc, Length
unit_y = UnitY(Factor=1)
end_points = EndPoints(Curve=arc.Arc)  # -> Start, End
line_sdl = LineSDL(Start=end_points.Start, Direction=unit_y, Length=1)
pi = Pi(Factor=1)
rotate_axis = RotateAxis(Geometry=arc.Arc, Angle=pi, Axis=line_sdl)  # -> Geometry, Transform
join_curves = JoinCurves(Curves=[rotate_axis.Geometry, arc.Arc], Preserve=False)

# ----
series = Series(Start=0, Step="4", Count=number_of_arcs_2)
multiplication = Multiplication(A=arc_radius_2, B=series)
unit_x = UnitX(Factor=multiplication)

# ----
# TOTAL ARCS
move = Move(Geometry=join_curves, Motion=unit_x)  # -> flatten(Geometry), Transform
join_curves_2 = JoinCurves(Curves=move.Geometry, Preserve=False)

multiplication_2 = Multiplication(A=number_of_arcs_2, B=2)
subtraction = Subtraction(A=multiplication_2, B=1)
multiplication_3 = Multiplication(A=subtraction, B=arc_radius_2)
unit_y_2 = UnitY(Factor=multiplication_3)
unit_x_2 = UnitX(Factor=multiplication_3)
point = Point(Point(0, 0, 0))
move_2 = Move(Geometry=point, Motion=unit_x_2)  # -> Geometry, Transform
move_3 = Move(Geometry=move_2.Geometry, Motion=unit_y_2)  # -> Geometry, Transform
extrude_point = ExtrudePoint(Base=join_curves_2, Point=move_3.Geometry)
surface = Surface(extrude_point)

# ----
# PATTERN ON MESH
triremesh = TriRemesh(Geometry=surface, Length=mesh_size, Iterations=25)  # -> Triangulation, Dual, Creases

mesh = Mesh(triremesh.Dual)
face_boundaries = FaceBoundaries(Mesh=mesh)
point_2 = Point(Point(99.96015858, 43.00794666, 0))
pull_point = PullPoint(Point=point_2, Geometry=graft(face_boundaries), ClosestOnly=True)  # -> ClosestPoint, Distance
discontinuity = Discontinuity(Curve=face_boundaries, Level=1)  # -> Points, Parameters
bounds = Bounds(Numbers=flatten(pull_point.Distance))
average = Average(Input=discontinuity.Points)  # -> flatten(ArithmeticMean)
remap_numbers = RemapNumbers(Value=pull_point.Distance, Source=bounds, Target="0.1 to 1")  # -> Mapped, Clipped
graph_mapper = GraphMapper(
    flatten(remap_numbers.Mapped),
    x0=0,
    x1=1,
    y0=0,
    y1=1,
    container_name="Sine",
    Equation_px=[0, 0.1993912458],
    Equation_py=[0.07510334253, 0.8917713761])
scale = Scale(Geometry=face_boundaries, Center=average, Factor=graph_mapper)  # -> Geometry, Transform
entwine = Entwine(Branch00=scale.Geometry, Branch01=face_boundaries, FlattenInputs=True)
flip_matrix = FlipMatrix(Data=entwine)

# ----
# PERFORATED FRAMES & PANELS
loft = Loft(Curves=flip_matrix, Options={Adjust=False, Closed=False, LoftEnds=0, LoftSimp=0, LoftType=0, Rebuild=10, Refit=0.01})

context_bake = ContextBake(FinalSurface=loft)
